vi "Calculator.gvi"   [LabVIEW NXG 1.0.0]
# 9-27-2017 Converted to LabVIEW NXG
# Rick Wagner
# Digalog Systems Inc.
# This VI is a fully-functional calculator built in LabVIEW. It demonstrates the following concepts taught in the LabVIEW Basics class.
# - Dataflow Programming
# - Modular Programming
# - While Loops
# - Shift Registers
# - Case Structures
# - Functional Global Variables
# - Event-Driven Programming
# - VI Documentation
# - Control/Indicator Documentation
# - Custom Controls/Type Definitions
# - LabVIEW Project and Application Builder
# Author: Erik Johnson, National Instruments
panel controls:
  "One": bool
  "Three": bool  # Three
  "Four": bool  # Four
  "Five": bool  # Five
  "Six": bool  # Six
  "Seven": bool  # Seven
  "Eight": bool  # Eight
  "Nine": bool  # Nine
  "Zero": bool  # Zero
  "Add": bool  # Add
  "Subtract": bool  # Subtract
  "Multiply": bool  # Multiply
  "Divide": bool  # Divide
  "Equals": bool  # Get Result
  "Clear Entry": bool  # Clear Entry - clears the current entry.
  "Clear All": bool  # Clear All - clears everything.
  "Backspace": bool  # Backspace - removes most recently entered number.
  "Negate": bool  # Negative
  "Square Root": bool  # Square Root
  "Squared": bool  # Squared
  "Inverse": bool  # Invert
  "Decimal": bool  # Decimal Point - adds a decimal point at the end of the current number.
  "Memory Recall": bool  # Memory Recall - recalls the value from memory and puts it on the display.
  "Memory Store": bool  # Memory Store - stores the value currently in the display to memory.
  "Memory Add": bool  # Memory Add - add the value in the display to the number currently in memory.
  "Two": bool  # Two
  "Memory Clear": bool
  "Switch": bool
panel indicators:
  "Display": f64
  "Memory": bool
uses:
  NI::G Core::Error::Display Error.gvi
diagram:
  w1 = "Equals"  # Last Operation Selected
  call "Memory Functional Global.gvi"(Memory Option="Memory Clear") -> (error out=w2)
  w3 = 0  # Decimal Count
  w4 = 0  # Stored Number
  w5 = 0  # Display
  w6 = FALSE  # Was the Last Button +-*/?
  # 0 = Not Decimal Mode
  # >0 = Decimal Mode
  s1 = w4  # shift register
  s2 = w5  # shift register
  s3 = w1  # shift register
  s4 = w6  # shift register
  s5 = w3  # shift register
  s6 = w2  # shift register
  s7 = FALSE  # shift register
  while {
    $Display <- s2
    event {
      on "One" Value changed {
        # This event occurs if the user presses any of the number
        # buttons on the calculator.
        case (s4) {
          frame True {
            # Last button was an operand, refresh the display.
            w15 = 1
            w9 = s2
            w12 = s5
            w16 = s6
          }
          frame False {
            # Add the new number to the display
            call "Add To Display.gvi"(Number In=1, Display In=s2, Decimal Count In=s5, error in (no error)=s6) -> (Display Out=w15, Decimal Count Out=w12, error out=w16)
            w9 = s1
          }
        }
        call "Overflow Protection.gvi"(Display Before=s2, Display After=w15, error in (no error)=w16) -> (Display Output=w7, error out=w13)
        w8 = FALSE
        w10 = s3
        w11 = FALSE
        w14 = s7
      }
      on "Two" Value changed {
        # This event occurs if the user presses any of the number
        # buttons on the calculator.
        case (s4) {
          frame True {
            # Last button was an operand, refresh the display.
            w17 = 2
            w9 = s2
            w12 = s5
            w18 = s6
          }
          frame False {
            # Add the new number to the display
            call "Add To Display.gvi"(Number In=2, Display In=s2, Decimal Count In=s5, error in (no error)=s6) -> (Display Out=w17, Decimal Count Out=w12, error out=w18)
            w9 = s1
          }
        }
        call "Overflow Protection.gvi"(Display Before=s2, Display After=w17, error in (no error)=w18) -> (Display Output=w7, error out=w13)
        w8 = FALSE
        w10 = s3
        w11 = FALSE
        w14 = s7
      }
      on "Three" Value changed {
        # This event occurs if the user presses any of the number
        # buttons on the calculator.
        case (s4) {
          frame True {
            # Last button was an operand, refresh the display.
            w19 = 3
            w9 = s2
            w12 = s5
            w20 = s6
          }
          frame False {
            # Add the new number to the display
            call "Add To Display.gvi"(Number In=3, Display In=s2, Decimal Count In=s5, error in (no error)=s6) -> (Display Out=w19, Decimal Count Out=w12, error out=w20)
            w9 = s1
          }
        }
        call "Overflow Protection.gvi"(Display Before=s2, Display After=w19, error in (no error)=w20) -> (Display Output=w7, error out=w13)
        w8 = FALSE
        w10 = s3
        w11 = FALSE
        w14 = s7
      }
      on "Four" Value changed {
        # This event occurs if the user presses any of the number
        # buttons on the calculator.
        case (s4) {
          frame True {
            # Last button was an operand, refresh the display.
            w21 = 4
            w9 = s2
            w12 = s5
            w22 = s6
          }
          frame False {
            # Add the new number to the display
            call "Add To Display.gvi"(Number In=4, Display In=s2, Decimal Count In=s5, error in (no error)=s6) -> (Display Out=w21, Decimal Count Out=w12, error out=w22)
            w9 = s1
          }
        }
        call "Overflow Protection.gvi"(Display Before=s2, Display After=w21, error in (no error)=w22) -> (Display Output=w7, error out=w13)
        w8 = FALSE
        w10 = s3
        w11 = FALSE
        w14 = s7
      }
      on "Five" Value changed {
        # This event occurs if the user presses any of the number
        # buttons on the calculator.
        case (s4) {
          frame True {
            # Last button was an operand, refresh the display.
            w23 = 5
            w9 = s2
            w12 = s5
            w24 = s6
          }
          frame False {
            # Add the new number to the display
            call "Add To Display.gvi"(Number In=5, Display In=s2, Decimal Count In=s5, error in (no error)=s6) -> (Display Out=w23, Decimal Count Out=w12, error out=w24)
            w9 = s1
          }
        }
        call "Overflow Protection.gvi"(Display Before=s2, Display After=w23, error in (no error)=w24) -> (Display Output=w7, error out=w13)
        w8 = FALSE
        w10 = s3
        w11 = FALSE
        w14 = s7
      }
      on "Six" Value changed {
        # This event occurs if the user presses any of the number
        # buttons on the calculator.
        case (s4) {
          frame True {
            # Last button was an operand, refresh the display.
            w25 = 6
            w9 = s2
            w12 = s5
            w26 = s6
          }
          frame False {
            # Add the new number to the display
            call "Add To Display.gvi"(Number In=6, Display In=s2, Decimal Count In=s5, error in (no error)=s6) -> (Display Out=w25, Decimal Count Out=w12, error out=w26)
            w9 = s1
          }
        }
        call "Overflow Protection.gvi"(Display Before=s2, Display After=w25, error in (no error)=w26) -> (Display Output=w7, error out=w13)
        w8 = FALSE
        w10 = s3
        w11 = FALSE
        w14 = s7
      }
      on "Seven" Value changed {
        # This event occurs if the user presses any of the number
        # buttons on the calculator.
        case (s4) {
          frame True {
            # Last button was an operand, refresh the display.
            w27 = 7
            w9 = s2
            w12 = s5
            w28 = s6
          }
          frame False {
            # Add the new number to the display
            call "Add To Display.gvi"(Number In=7, Display In=s2, Decimal Count In=s5, error in (no error)=s6) -> (Display Out=w27, Decimal Count Out=w12, error out=w28)
            w9 = s1
          }
        }
        call "Overflow Protection.gvi"(Display Before=s2, Display After=w27, error in (no error)=w28) -> (Display Output=w7, error out=w13)
        w8 = FALSE
        w10 = s3
        w11 = FALSE
        w14 = s7
      }
      on "Eight" Value changed {
        # This event occurs if the user presses any of the number
        # buttons on the calculator.
        case (s4) {
          frame True {
            # Last button was an operand, refresh the display.
            w29 = 8
            w9 = s2
            w12 = s5
            w30 = s6
          }
          frame False {
            # Add the new number to the display
            call "Add To Display.gvi"(Number In=8, Display In=s2, Decimal Count In=s5, error in (no error)=s6) -> (Display Out=w29, Decimal Count Out=w12, error out=w30)
            w9 = s1
          }
        }
        call "Overflow Protection.gvi"(Display Before=s2, Display After=w29, error in (no error)=w30) -> (Display Output=w7, error out=w13)
        w8 = FALSE
        w10 = s3
        w11 = FALSE
        w14 = s7
      }
      on "Nine" Value changed {
        # This event occurs if the user presses any of the number
        # buttons on the calculator.
        case (s4) {
          frame True {
            # Last button was an operand, refresh the display.
            w31 = 9
            w9 = s2
            w12 = s5
            w32 = s6
          }
          frame False {
            # Add the new number to the display
            call "Add To Display.gvi"(Number In=9, Display In=s2, Decimal Count In=s5, error in (no error)=s6) -> (Display Out=w31, Decimal Count Out=w12, error out=w32)
            w9 = s1
          }
        }
        call "Overflow Protection.gvi"(Display Before=s2, Display After=w31, error in (no error)=w32) -> (Display Output=w7, error out=w13)
        w8 = FALSE
        w10 = s3
        w11 = FALSE
        w14 = s7
      }
      on "Zero" Value changed {
        # This event occurs if the user presses any of the number
        # buttons on the calculator.
        case (s4) {
          frame True {
            # Last button was an operand, refresh the display.
            w33 = 0
            w9 = s2
            w12 = s5
            w34 = s6
          }
          frame False {
            # Add the new number to the display
            call "Add To Display.gvi"(Number In=0, Display In=s2, Decimal Count In=s5, error in (no error)=s6) -> (Display Out=w33, Decimal Count Out=w12, error out=w34)
            w9 = s1
          }
        }
        call "Overflow Protection.gvi"(Display Before=s2, Display After=w33, error in (no error)=w34) -> (Display Output=w7, error out=w13)
        w8 = FALSE
        w10 = s3
        w11 = FALSE
        w14 = s7
      }
      on "Add" Value changed {
        # This event occurs if any of the Operation buttons are pressed
        # (example: +, -, *, /, =)
        case (s4) {
          frame False, Default {
            case (s3) {
              frame "Add" {
                Add(s1, s2) -> w35
              }
              frame "Subtract" {
                Subtract(x=s1, y=s2) -> w35
              }
              frame "Multiply" {
                Multiply(s1, s2) -> w35
              }
              frame "Divide" {
                Divide(x=s1, y=s2) -> w35
              }
              frame "Equals", Default {
                w35 = s2
              }
            }
            w9 = w35
          }
          frame True {
            # If the last button was an operation, overwrite it and throw out the previous operation.
            w35 = s2
            w9 = s1
          }
        }
        call "Overflow Protection.gvi"(Display Before=w35, Display After=w35, error in (no error)=s6) -> (Display Output=w7, error out=w13)
        w8 = FALSE
        w10 = "Add"
        w11 = TRUE
        w12 = 0
        w14 = s7
      }
      on "Subtract" Value changed {
        # This event occurs if any of the Operation buttons are pressed
        # (example: +, -, *, /, =)
        case (s4) {
          frame False, Default {
            case (s3) {
              frame "Add" {
                Add(s1, s2) -> w36
              }
              frame "Subtract" {
                Subtract(x=s1, y=s2) -> w36
              }
              frame "Multiply" {
                Multiply(s1, s2) -> w36
              }
              frame "Divide" {
                Divide(x=s1, y=s2) -> w36
              }
              frame "Equals", Default {
                w36 = s2
              }
            }
            w9 = w36
          }
          frame True {
            # If the last button was an operation, overwrite it and throw out the previous operation.
            w36 = s2
            w9 = s1
          }
        }
        call "Overflow Protection.gvi"(Display Before=w36, Display After=w36, error in (no error)=s6) -> (Display Output=w7, error out=w13)
        w8 = FALSE
        w10 = "Subtract"
        w11 = TRUE
        w12 = 0
        w14 = s7
      }
      on "Multiply" Value changed {
        # This event occurs if any of the Operation buttons are pressed
        # (example: +, -, *, /, =)
        case (s4) {
          frame False, Default {
            case (s3) {
              frame "Add" {
                Add(s1, s2) -> w37
              }
              frame "Subtract" {
                Subtract(x=s1, y=s2) -> w37
              }
              frame "Multiply" {
                Multiply(s1, s2) -> w37
              }
              frame "Divide" {
                Divide(x=s1, y=s2) -> w37
              }
              frame "Equals", Default {
                w37 = s2
              }
            }
            w9 = w37
          }
          frame True {
            # If the last button was an operation, overwrite it and throw out the previous operation.
            w37 = s2
            w9 = s1
          }
        }
        call "Overflow Protection.gvi"(Display Before=w37, Display After=w37, error in (no error)=s6) -> (Display Output=w7, error out=w13)
        w8 = FALSE
        w10 = "Multiply"
        w11 = TRUE
        w12 = 0
        w14 = s7
      }
      on "Divide" Value changed {
        # This event occurs if any of the Operation buttons are pressed
        # (example: +, -, *, /, =)
        case (s4) {
          frame False, Default {
            case (s3) {
              frame "Add" {
                Add(s1, s2) -> w38
              }
              frame "Subtract" {
                Subtract(x=s1, y=s2) -> w38
              }
              frame "Multiply" {
                Multiply(s1, s2) -> w38
              }
              frame "Divide" {
                Divide(x=s1, y=s2) -> w38
              }
              frame "Equals", Default {
                w38 = s2
              }
            }
            w9 = w38
          }
          frame True {
            # If the last button was an operation, overwrite it and throw out the previous operation.
            w38 = s2
            w9 = s1
          }
        }
        call "Overflow Protection.gvi"(Display Before=w38, Display After=w38, error in (no error)=s6) -> (Display Output=w7, error out=w13)
        w8 = FALSE
        w10 = "Divide"
        w11 = TRUE
        w12 = 0
        w14 = s7
      }
      on "Equals" Value changed {
        # This event occurs if any of the Operation buttons are pressed
        # (example: +, -, *, /, =)
        case (s4) {
          frame False, Default {
            case (s3) {
              frame "Add" {
                Add(s1, s2) -> w39
              }
              frame "Subtract" {
                Subtract(x=s1, y=s2) -> w39
              }
              frame "Multiply" {
                Multiply(s1, s2) -> w39
              }
              frame "Divide" {
                Divide(x=s1, y=s2) -> w39
              }
              frame "Equals", Default {
                w39 = s2
              }
            }
            w9 = w39
          }
          frame True {
            # If the last button was an operation, overwrite it and throw out the previous operation.
            w39 = s2
            w9 = s1
          }
        }
        call "Overflow Protection.gvi"(Display Before=w39, Display After=w39, error in (no error)=s6) -> (Display Output=w7, error out=w13)
        w8 = FALSE
        w10 = "Equals"
        w11 = TRUE
        w12 = 0
        w14 = s7
      }
      on "Backspace" Value changed {
        # This event occurs if the user presses the backspace button.
        case (s4) {
          frame False, Default {
            # Last button was not an operand
            # execute the backspace.
            call "Backspace.gvi"(Decimal Count In=s5, Display In=s2, error in (no error)=s6) -> (Decimal Count Out=w12, Display Out=w7, error out=w13)
          }
          frame True {
            # Last button was an operand,
            # no need to delete anything.
            w7 = s2
            w12 = s5
            w13 = s6
          }
        }
        w8 = FALSE
        w9 = s1
        w10 = s3
        w11 = s4
        w14 = s7
      }
      on "Clear Entry" Value changed {
        # Clear entry only clears the display.
        w7 = 0
        w8 = FALSE
        w9 = s1
        w10 = s3
        w11 = s4
        w12 = 0
        w13 = s6
        w14 = s7
      }
      on "Clear All" Value changed {
        # This event occurs if the user presses the Clear Entry (CE)
        # or Clear All (C) buttons.
        # Clear entry only clears the display.
        # Clear all clears the display and stored number.
        w40 = "Equals"  # Operation Button
        call "Memory Functional Global.gvi"(error in (no error)=s6, Memory Option="Memory Clear") -> (Memory=w14, error out=w13)
        w7 = 0
        w8 = FALSE
        w9 = 0
        w10 = w40
        w11 = s4
        w12 = 0
      }
      on "Negate" Value changed {
        # This event executes if the user presses the Negate (-x),
        # Square Root (sqrt), Squared (x^2), or Inverse (1/x) buttons.
        Negate(x=s2) -> w7
        w8 = FALSE
        w9 = s1
        w10 = s3
        w11 = s4
        w12 = s5
        w13 = s6
        w14 = s7
      }
      on "Square Root" Value changed {
        # This event executes if the user presses the Negate (-x),
        # Square Root (sqrt), Squared (x^2), or Inverse (1/x) buttons.
        Square Root(x=s2) -> w7
        w8 = FALSE
        w9 = s1
        w10 = s3
        w11 = s4
        w12 = s5
        w13 = s6
        w14 = s7
      }
      on "Squared" Value changed {
        # This event executes if the user presses the Negate (-x),
        # Square Root (sqrt), Squared (x^2), or Inverse (1/x) buttons.
        Square(x=s2) -> w7
        w8 = FALSE
        w9 = s1
        w10 = s3
        w11 = s4
        w12 = s5
        w13 = s6
        w14 = s7
      }
      on "Inverse" Value changed {
        # This event executes if the user presses the Negate (-x),
        # Square Root (sqrt), Squared (x^2), or Inverse (1/x) buttons.
        Reciprocal(x=s2) -> w7
        w8 = FALSE
        w9 = s1
        w10 = s3
        w11 = s4
        w12 = s5
        w13 = s6
        w14 = s7
      }
      on "Decimal" Value changed {
        # This event executs if the decimal (.) button is pressed.
        Is Equal To 0(x=s5) -> w41
        # Enter decimal mode.
        # If we are already in decmial mode (>0),
        # keep the decimal count.
        Select(s=w41, t=1, f=s5) -> w12
        Select(s=s4, t=0, f=s2) -> w7
        # If the last button was an operand, clear the display.
        w8 = FALSE
        w9 = s1
        w10 = s3
        w11 = FALSE
        w13 = s6
        w14 = s7
      }
      on "Memory Clear" Value changed {
        call "Memory Functional Global.gvi"(Number In=s2, error in (no error)=s6, Memory Option="Memory Clear") -> (Memory=w14, Number Out=w7, error out=w13)
        w8 = FALSE
        w9 = s1
        w10 = "Equals"
        w11 = TRUE
        w12 = 0
      }
      on "Memory Recall" Value changed {
        call "Memory Functional Global.gvi"(Number In=s2, error in (no error)=s6, Memory Option="Memory Recall") -> (Memory=w14, Number Out=w7, error out=w13)
        # MR is not an operand, the rest are
        w8 = FALSE
        w9 = s1
        w10 = s3
        w11 = FALSE
        w12 = 0
      }
      on "Memory Store" Value changed {
        call "Memory Functional Global.gvi"(Number In=s2, error in (no error)=s6, Memory Option="Memory Store") -> (Memory=w14, Number Out=w7, error out=w13)
        w8 = FALSE
        w9 = s1
        w10 = "Equals"
        w11 = TRUE
        w12 = 0
      }
      on "Memory Add" Value changed {
        # MR is not an operand, the rest are
        call "Memory Functional Global.gvi"(Number In=s2, error in (no error)=s6, Memory Option="Memory Add") -> (Memory=w14, Number Out=w7, error out=w13)
        w8 = FALSE
        w9 = s1
        w10 = "Equals"
        w11 = TRUE
        w12 = 0
      }
      on "Switch" Value changed {
        w7 = s2
        w8 = $Switch
        w9 = s1
        w10 = default
        w11 = s4
        w12 = s5
        w13 = s6
        w14 = s7
      }
    }
    $Memory <- w14
    Property Node(instance in=w13) -> ("status"=w42)
    Logical Or(w42, w8) -> w43
    $Switch <- FALSE
    next s1 = w9
    next s2 = w7
    next s3 = w10
    next s4 = w11
    next s5 = w12
    next s6 = w13
    next s7 = w14
    stop if w43
  }
  call "Display Error.gvi"(error in=s6)
