vi "Add To Display.gvi"   [LabVIEW NXG 1.0.0]
# 9-27-2017 Converted to LabVIEW NXG
# Rick Wagner
# Digalog Systems Inc.
# This VI applies a decimal and increments the decimal count if we are in decimal mode (decimal count > 0).
# Author: Erik Johnson, National Instruments
inputs:
  "Number In": f64
  "Display In": f64
  "Decimal Count In": u8
  "error in (no error)": error
outputs:
  "Display Out": f64
  "Decimal Count Out": u8
  "error out": error
uses:
  NI::G Core::Error::Clear Errors.gvi
diagram:
  case ($"error in (no error)") {
    frame No Error {
      # Apply decimal
      # Add number to display
      C Code Node("x"=$"Number In", "n"=$"Decimal Count In") -> ("y"=w4, Error Out=w5)
      ~~~
      // Code in a Formula Node was converted to code in a C Node.
      // Review the converted code to ensure it has the same behavior
      // as the original code.


      // ORIGINAL CODE:

      // y=x/10**n;


      // CONVERTED CODE:

      // Warnings:
      //   #1: The operator '**' is not supported in the C Node. Please manually replace all instances with the pow(x,y) C function.
      double z;
      z=pow(10,n);
      y=x/z;
      ~~~
      call "Clear Errors.gvi"(error in=w5)
      Is Greater Than 0(x=$"Decimal Count In") -> w6
      Multiply($"Display In", 10) -> w7
      Select(s=w6, t=$"Display In", f=w7) -> w8
      # Check for negative
      Subtract(x=w8, y=w4) -> w9
      Is Less Than 0(x=w8) -> w10
      Add(w8, w4) -> w11
      Select(s=w10, t=w9, f=w11) -> w2
      Increment(x=$"Decimal Count In") -> w12
      Select(s=w6, t=w12, f=$"Decimal Count In") -> w1
      w3 = $"error in (no error)"
    }
    frame Error {
      # If there is an error, skip adding any numbers and report the error.
      # Also, display Inf to the screen to indicate error.
      w1 = 0
      w2 = Inf
      w3 = $"error in (no error)"
    }
  }
  $"Display Out" <- w2
  $"Decimal Count Out" <- w1
  $"error out" <- w3
