vi "Backspace.gvi"   [LabVIEW NXG 1.0.0]
# 9-27-2017 Converted to LabVIEW NXG
# Rick Wagner
# Digalog Systems Inc.
# This VI handles the backspacing of a decimal number. The way it works is as follows:
# The display is multiplied by 10 raised to however many decimals it has to make it a whole number (ex: 12.34 * 10^2 = 1234).
# Next, we Mod 10 the display (ex: 1234 = 123).
# Finally, we divide the display by the 10 raised to the number of decimals it had minus one (ex: 123 / 10^1 = 12.3)
# Author: Erik Johnson, National Instruments
inputs:
  "Decimal Count In": u8
  "Display In": f64
  "error in (no error)": error
outputs:
  "Decimal Count Out": u8
  "Display Out": f64
  "error out": error
uses:
  NI::G Core::Error::Clear Errors.gvi
diagram:
  case ($"error in (no error)") {
    frame No Error {
      Is Less Than 0(x=$"Display In") -> w4
      # If negative, flip to positive for the backspace operation.
      Is Greater(x=$"Decimal Count In", y=1) -> w5
      Negate(x=$"Display In") -> w6
      Select(s=w4, t=w6, f=$"Display In") -> w7
      case (w5) {
        frame False, Default {
          Is Equal To 0(x=$"Decimal Count In") -> w9
          Decrement(x=$"Decimal Count In") -> w10
          # Exit Decimal mode
          Select(s=w9, t=$"Decimal Count In", f=w10) -> w1
          # Mod 10 the display to remove last digit
          Quotient And Remainder(x=w7, y=10) -> (floor(x/y)=w8)
        }
        frame True {
          C Code Node("n"=$"Decimal Count In") -> ("y"=w11, Error Out=w12)
          ~~~
          // Code in a Formula Node was converted to code in a C Node.
          // Review the converted code to ensure it has the same behavior
          // as the original code.


          // ORIGINAL CODE:

          // y=10**(n-1);


          // CONVERTED CODE:

          // Warnings:
          //   #2: The operator '**' is not supported in the C Node. Please manually replace all instances with the pow(x,y) C function.
          n=n-1;
          y=pow(10,n);
          ~~~
          call "Clear Errors.gvi"(error in=w12)
          Decrement(x=$"Decimal Count In") -> w1
          C Code Node("n"=w1) -> ("y"=w13, Error Out=w14)
          ~~~
          // Code in a Formula Node was converted to code in a C Node.
          // Review the converted code to ensure it has the same behavior
          // as the original code.


          // ORIGINAL CODE:

          // y=10**(n-1);


          // CONVERTED CODE:

          // Warnings:
          //   #3: The operator '**' is not supported in the C Node. Please manually replace all instances with the pow(x,y) C function.
          n=n-1;
          y=pow(10,n);
          ~~~
          call "Clear Errors.gvi"(error in=w14)
          Multiply(w11, w7) -> w15
          Quotient And Remainder(x=w15, y=10) -> (floor(x/y)=w16)
          Divide(x=w16, y=w13) -> w8
        }
      }
      # Flip back to positive if negative.
      Negate(x=w8) -> w17
      Select(s=w4, t=w17, f=w8) -> w2
      w3 = $"error in (no error)"
    }
    frame Error {
      # If there is an error, don't bother backspacing.  Just report the error and display Inf to indicate an error.
      w1 = 0
      w2 = Inf
      w3 = $"error in (no error)"
    }
  }
  $"Decimal Count Out" <- w1
  $"Display Out" <- w2
  $"error out" <- w3
