vi "Overflow Protection.gvi"   [LabVIEW NXG 1.0.0]
# 9-27-2017 Converted to LabVIEW NXG
# Rick Wagner
# Digalog Systems Inc.
# This VI protects the Calculator against overflow, it will not allow numbers greater than 1E+15.
# Author: Erik Johnson, National Instruments
inputs:
  "Display Before": f64, required
  "Display After": f64, required
  "error in (no error)": error
outputs:
  "Display Output": f64
  "error out": error
diagram:
  case ($"error in (no error)") {
    frame No Error {
      Is Greater(x=$"Display After", y=1e+15) -> w3
      Select(s=w3, t=$"Display Before", f=$"Display After") -> w4
      # This VI protects against overflow and underflow.
      Is Less(x=w4, y=-1e+15) -> w5
      Select(s=w5, t=$"Display Before", f=$"Display After") -> w6
      Is Less(x=w6, y=0) -> w7
      Negate(x=w6) -> w8
      Select(s=w7, t=w8, f=w6) -> w9
      Is Greater(x=w9, y=0) -> w10
      # Limit decimal count to15 decimal places.
      Is Less(x=w9, y=1e-15) -> w11
      Logical And(w10, w11) -> w12
      Select(s=w12, t=0, f=w9) -> w13
      Negate(x=w13) -> w14
      Select(s=w7, t=w14, f=w13) -> w1
      w2 = $"error in (no error)"
    }
    frame Error {
      w1 = Inf
      w2 = $"error in (no error)"
    }
  }
  $"Display Output" <- w1
  $"error out" <- w2
